# Grasshopper definition Yuan_Wang_ma10.gh (Grasshopper 1.0.8)
# plug-ins: RhinoCodePluginGH

# ----
# The Python component contains a definition for the class Pyramid
# 
# Task 1:
# Define a new method called GetSurfaceArea that returns the total surface area of the pyramid
# 
# Task 2:
# Define a new method called Move that takes in a parameter of type Vector3d, and move the Pyramid according to this vector.
# 
# Task 3:
# Define a new method called Flip that returns a NEW pyramid where the orientation is rotated by 180 degree around its base frame's X axis
# 
# Task 4:
# Extend the Pyramid class into a new, derived class. Add a minimum of 2 new properties and 2 new methods to the class. i.e. a Building class that inherits Pyramid and adds a window property.
# Task 1: Get the Total Surface Area
# Using this Equation to get the total Surface Area (A)
python_3_script = Python3Script()  # -> out, a, b, total_surface_area
# ---------- python_3_script: Python ----------
import Rhino.Geometry as rg
import math

class Pyramid:   
    def __init__(self, baseFrame, width, length, height):
        self.BaseFrame = baseFrame
        self.Width = width
        self.Length = length
        self.Height = height

    def GetEdges(self):
        A = self.BaseFrame.Origin - self.BaseFrame.XAxis * 0.5 * self.Width + self.BaseFrame.YAxis * 0.5 * self.Length
        B = self.BaseFrame.Origin + self.BaseFrame.XAxis * 0.5 * self.Width + self.BaseFrame.YAxis * 0.5 * self.Length
        C = self.BaseFrame.Origin + self.BaseFrame.XAxis * 0.5 * self.Width - self.BaseFrame.YAxis * 0.5 * self.Length
        D = self.BaseFrame.Origin - self.BaseFrame.XAxis * 0.5 * self.Width - self.BaseFrame.YAxis * 0.5 * self.Length
        M = self.BaseFrame.Origin + self.BaseFrame.ZAxis * self.Height
        edges = []
        edges.append(rg.Line(A, B))
        edges.append(rg.Line(B, C))
        edges.append(rg.Line(C, D))
        edges.append(rg.Line(D, A))
        edges.append(rg.Line(A, M))
        edges.append(rg.Line(B, M))
        edges.append(rg.Line(C, M))
        edges.append(rg.Line(D, M))
        return edges

    def GetVolume(self):
        return self.Width * self.Height * self.Length / 3

    def ComputeDensity(self, mass):
        volume = self.GetVolume()
        return mass / volume;
    
    def Duplicate(self):
        newPyramid = Pyramid(self.BaseFrame, self.Width, self.Length, self.Height)
        return newPyramid
           
    def GetSurfaceArea(self): 
        # Total Surface Area = Base Area + two Triangles of Length side + Two Trangles of Width side 
        base_area = self.Width * self.Length 
        Triangles_onLength = self.Length * math.sqrt((self.Width / 2) ** 2 + self.Height ** 2) 
        Triangles_onWidth = self.Width * math.sqrt((self.Length / 2) ** 2 + self.Height ** 2) 
        
        total_surface_area = base_area + Triangles_onLength + Triangles_onWidth
        return total_surface_area

myPyramid = Pyramid(rg.Plane.WorldXY, 2, 6, 4)
yourPyramid = myPyramid.Duplicate()

a = myPyramid.GetEdges()
b = yourPyramid.GetEdges()

total_surface_area = yourPyramid.GetSurfaceArea ()
# ---------- end python_3_script ----------
panel = Panel(python_3_script.total_surface_area)
geometry = Geometry(python_3_script.a)
image_sampler = ImageSampler(Filter="Colour", Interpolate=False, Umax=1, Umin=0, Vmax=1, Vmin=0, Wrap=1)

# ----
# Task 4:  Statement + Pyramid Base Perimeter
python_3_script_2 = Python3Script()  # -> out, a, b, statement, base_perimeter
# ---------- python_3_script_2: Python ----------
import Rhino.Geometry as rg
import math

class Pyramid:   
    def __init__(self, baseFrame, width, length, height):
        self.BaseFrame = baseFrame
        self.Width = width
        self.Length = length
        self.Height = height

    def GetEdges(self):
        A = self.BaseFrame.Origin - self.BaseFrame.XAxis * 0.5 * self.Width + self.BaseFrame.YAxis * 0.5 * self.Length
        B = self.BaseFrame.Origin + self.BaseFrame.XAxis * 0.5 * self.Width + self.BaseFrame.YAxis * 0.5 * self.Length
        C = self.BaseFrame.Origin + self.BaseFrame.XAxis * 0.5 * self.Width - self.BaseFrame.YAxis * 0.5 * self.Length
        D = self.BaseFrame.Origin - self.BaseFrame.XAxis * 0.5 * self.Width - self.BaseFrame.YAxis * 0.5 * self.Length
        M = self.BaseFrame.Origin + self.BaseFrame.ZAxis * self.Height
        edges = []
        edges.append(rg.Line(A, B))
        edges.append(rg.Line(B, C))
        edges.append(rg.Line(C, D))
        edges.append(rg.Line(D, A))
        edges.append(rg.Line(A, M))
        edges.append(rg.Line(B, M))
        edges.append(rg.Line(C, M))
        edges.append(rg.Line(D, M))
        return edges

    def GetVolume(self):
        return self.Width * self.Height * self.Length / 3

    def ComputeDensity(self, mass):
        volume = self.GetVolume()
        return mass / volume;
    
    def Duplicate(self):
        newPyramid = Pyramid(self.BaseFrame, self.Width, self.Length, self.Height)
        return newPyramid

myPyramid = Pyramid(rg.Plane.WorldXY, 2, 6, 4)
yourPyramid = myPyramid.Duplicate()

a = myPyramid.GetEdges()
b = yourPyramid.GetEdges()

class Lama_Pyramid (Pyramid):
    def __init__(self, baseFrame, width, length, height, material, location):
        super().__init__(baseFrame, width, length, height)
        self.Material = material
        self.Location = location   

    def State(self):
        return f"Lama_Pyramid: Material= {self.Material}, Location= {self.Location}, Width= {self.Width} m, Length= {self.Length} m, Height= {self.Height} m."

    def BasePerimeter(self):
        base_perimeter = 2 * (self.Width + self.Length)
        return f"Pyramid Base Perimeter is equal to: {base_perimeter} units."

myLama_Pyramid = Lama_Pyramid(rg.Plane.WorldXY, 2, 6, 4, material="Brick", location="Dubai")

statement = myLama_Pyramid.State()
base_perimeter = myLama_Pyramid.BasePerimeter()
# ---------- end python_3_script_2 ----------
panel_2 = Panel(python_3_script_2.base_perimeter)
panel_3 = Panel(python_3_script_2.statement)
geometry_2 = Geometry(python_3_script_2.a)

# ----
# Task 3: Flipping Pyramid
python_3_script_3 = Python3Script()  # -> out, a, b, flipped_pyramid
# ---------- python_3_script_3: Python ----------
import Rhino.Geometry as rg
import math

class Pyramid:   
    def __init__(self, baseFrame, width, length, height):
        self.BaseFrame = baseFrame
        self.Width = width
        self.Length = length
        self.Height = height

    def GetEdges(self):
        A = self.BaseFrame.Origin - self.BaseFrame.XAxis * 0.5 * self.Width + self.BaseFrame.YAxis * 0.5 * self.Length
        B = self.BaseFrame.Origin + self.BaseFrame.XAxis * 0.5 * self.Width + self.BaseFrame.YAxis * 0.5 * self.Length
        C = self.BaseFrame.Origin + self.BaseFrame.XAxis * 0.5 * self.Width - self.BaseFrame.YAxis * 0.5 * self.Length
        D = self.BaseFrame.Origin - self.BaseFrame.XAxis * 0.5 * self.Width - self.BaseFrame.YAxis * 0.5 * self.Length
        M = self.BaseFrame.Origin + self.BaseFrame.ZAxis * self.Height
        edges = []
        edges.append(rg.Line(A, B))
        edges.append(rg.Line(B, C))
        edges.append(rg.Line(C, D))
        edges.append(rg.Line(D, A))
        edges.append(rg.Line(A, M))
        edges.append(rg.Line(B, M))
        edges.append(rg.Line(C, M))
        edges.append(rg.Line(D, M))
        return edges

    def GetVolume(self):
        return self.Width * self.Height * self.Length / 3

    def ComputeDensity(self, mass):
        volume = self.GetVolume()
        return mass / volume;
    
    def Duplicate(self):
        newPyramid = Pyramid(self.BaseFrame, self.Width, self.Length, self.Height)
        return newPyramid
    
    def Flip(self):
        # Create a 180 degrees flipped pyramid around its base frame's X axis (by flipping the base)
        flippedBaseFrame = rg.Plane(self.BaseFrame)
        flippedBaseFrame.Rotate(math.radians(180), flippedBaseFrame.XAxis)
        flippedPyramid = Pyramid(flippedBaseFrame, self.Width, self.Length, self.Height)
        return flippedPyramid

myPyramid = Pyramid(rg.Plane.WorldXY, 2, 6, 4)
yourPyramid = myPyramid.Duplicate()

a = myPyramid.GetEdges()
b = yourPyramid.GetEdges()

flippedPyramid = myPyramid.Flip() 
flipped_pyramid = flippedPyramid.GetEdges()
# ---------- end python_3_script_3 ----------
geometry_3 = Geometry(python_3_script_3.a)
geometry_4 = Geometry(python_3_script_3.flipped_pyramid)

# ----
# Task 2: Moving Pyramid
python_3_script_4 = Python3Script()  # -> out, a, b, moved_pyramid
# ---------- python_3_script_4: Python ----------
import Rhino.Geometry as rg
import math

class Pyramid:   
    def __init__(self, baseFrame, width, length, height):
        self.BaseFrame = baseFrame
        self.Width = width
        self.Length = length
        self.Height = height

    def GetEdges(self):
        A = self.BaseFrame.Origin - self.BaseFrame.XAxis * 0.5 * self.Width + self.BaseFrame.YAxis * 0.5 * self.Length
        B = self.BaseFrame.Origin + self.BaseFrame.XAxis * 0.5 * self.Width + self.BaseFrame.YAxis * 0.5 * self.Length
        C = self.BaseFrame.Origin + self.BaseFrame.XAxis * 0.5 * self.Width - self.BaseFrame.YAxis * 0.5 * self.Length
        D = self.BaseFrame.Origin - self.BaseFrame.XAxis * 0.5 * self.Width - self.BaseFrame.YAxis * 0.5 * self.Length
        M = self.BaseFrame.Origin + self.BaseFrame.ZAxis * self.Height
        edges = []
        edges.append(rg.Line(A, B))
        edges.append(rg.Line(B, C))
        edges.append(rg.Line(C, D))
        edges.append(rg.Line(D, A))
        edges.append(rg.Line(A, M))
        edges.append(rg.Line(B, M))
        edges.append(rg.Line(C, M))
        edges.append(rg.Line(D, M))
        return edges

    def GetVolume(self):
        return self.Width * self.Height * self.Length / 3

    def ComputeDensity(self, mass):
        volume = self.GetVolume()
        return mass / volume;
    
    def Duplicate(self):
        newPyramid = Pyramid(self.BaseFrame, self.Width, self.Length, self.Height)
        return newPyramid
    
    def Move(self, vector):  
        # Moves the pyramid by moving its base frame using transform.translation method 
        translation = rg.Transform.Translation(vector) 
        self.BaseFrame.Transform(translation) 

myPyramid = Pyramid(rg.Plane.WorldXY, 2, 6, 4)
yourPyramid = myPyramid.Duplicate()

a = myPyramid.GetEdges()
b = yourPyramid.GetEdges()

moveVector = rg.Vector3d(10, 10, 5)
myPyramid.Move(moveVector)
moved_pyramid = myPyramid.GetEdges()
# ---------- end python_3_script_4 ----------
geometry_5 = Geometry(python_3_script_4.moved_pyramid)
geometry_6 = Geometry(python_3_script_4.a)
