# Grasshopper definition Yuan_Wang_ma9.gh (Grasshopper 1.0.8)

point = Point(Point(-0.1519798242, -0.0253299707, 0))
panel = Panel("recursive rectangle")
python = GhPythonScript(center=point, size=Slider(15, range=0..100), scale=Slider(0.6, range=0..10))  # -> a; inputs center: Point3d
# ---------- python: Python ----------
import Rhino.Geometry as rg

def draw_square(center, size):
    half = size / 2.0

    pts = [
        rg.Point3d(center.X - half, center.Y - half, center.Z),
        rg.Point3d(center.X + half, center.Y - half, center.Z),
        rg.Point3d(center.X + half, center.Y + half, center.Z),
        rg.Point3d(center.X - half, center.Y + half, center.Z),
        rg.Point3d(center.X - half, center.Y - half, center.Z)
    ]

    return rg.Polyline(pts)

def recursive_square(center, size, scale, curves):
    if size < 1:
        return

    curves.append(draw_square(center, size))
    recursive_square(center, size * scale, scale, curves)


# ========= 主程序 =========
curves = []
recursive_square(center, size, scale, curves)

a = curves
# ---------- end python ----------
curve = Curve(python)
